# Grasshopper definition mapbox.gh (Grasshopper 0.9.76)
# Copyright: Co-de-iT
# plug-ins: LunchBox

crv = Curve([<curve referenced from the Rhino model> x2])
boundary = BoundarySurfaces(Edges=crv)
# Right wing
srf = Surface(<surface referenced from the Rhino model>)
# Surface
srf_2 = Surface(<surface referenced from the Rhino model>)
Z = UnitZ(Factor=1)
# Left wing
srf_3 = Surface(<surface referenced from the Rhino model>)
area = Area(Geometry=boundary)  # -> Area, Centroid
extr = Extrude(Base=srf_2, Direction=Z)
merge = Merge(Data1=srf_3, Data2=srf)
ellipse = Ellipse(Plane=PlaneXY(0, 0, 0), Radius1=Slider(160, range=0..1000), Radius2=Slider(220, range=0..1000))  # -> Ellipse, Focus1, Focus2
circle = CircleCNR(Center=area.Centroid, Normal=Vector(0, 0, 1), Radius=Slider(280, range=0..1000))
Z_2 = UnitZ(Factor=Slider(17, range=0..20))
boundary_2 = BoundarySurfaces(Edges=ellipse.Ellipse)
rectangle = Rectangle(Plane=PlaneXY(0, 0, 0), XSize=Slider(10, range=-40..40), YSize=Slider(55, range=0..100), Radius=0)  # -> Rectangle, Length
X = UnitX(Factor=Slider(18.22, range=0..100))
series = Series(Start=0, Step=Slider(100, range=0..100), Count=Slider(23, range=0..100))
extr_2 = Extrude(Base=circle, Direction=Z_2)
area_2 = Area(Geometry=ellipse.Ellipse)  # -> Area, Centroid
move = Move(Geometry=rectangle.Rectangle, Motion=X)  # -> Geometry, Transform
Z_3 = UnitZ(Factor=Slider(0.69, range=0..1))
cap = CapHoles(Brep=extr_2)
offset = Offset(Surface=boundary_2, Distance=series, Retrim=True)
dom = ConstructDomain(DomainStart=Slider(1, range=0..1), DomainEnd=Slider(0.535, range=0..1))
Z_4 = UnitZ(Factor=Slider(2200.7, range=0..10000))
area_3 = Area(Geometry=cap)  # -> Area, Centroid
move_2 = Move(Geometry=move.Geometry, Motion=Z_3)  # -> Geometry, Transform
area_4 = Area(Geometry=offset)  # -> Area, Centroid
range = Range(Domain=dom, Steps=10)
Z_5 = UnitZ(Factor=1)
Z_6 = UnitZ(Factor=Slider(0.325, range=0..1))
scale = Scale(Geometry=cap, Center=area_3.Centroid, Factor=Slider(0.9, range=0..1))  # -> Geometry, Transform
move_3 = Move(Geometry=merge, Motion=Z_4)  # -> Geometry, Transform
Z_7 = UnitZ(Factor=Slider(9, range=0..20))
scale_2 = Scale(Geometry=offset, Center=area_4.Centroid, Factor=range)  # -> Geometry, Transform
line = LineSDL(Start=area_2.Centroid, Direction=Z_5, Length=Slider(2200, range=0..10000))
extr_3 = Extrude(Base=move_2.Geometry, Direction=Z_6)
Y = UnitY(Factor=expr("-x", Slider(759, range=0..1000)))
X_2 = UnitX(Factor=expr("-x", Slider(699, range=0..1000)))
area_5 = Area(Geometry=scale_2.Geometry)  # -> Area, Centroid
move_4 = Move(Geometry=scale.Geometry, Motion=Z_7)  # -> Geometry, Transform
pipe = Pipe(Curve=line, Radius=Slider(50, range=0..100), Caps=0)
# runway
cap_2 = CapHoles(Brep=extr_3)
end = EndPoints(Curve=line)  # -> Start, End
scale_3 = Scale(Geometry=move_3.Geometry, Center=end.End, Factor=Slider(30, range=0..100))  # -> Geometry, Transform
number_slider = Slider(5, range=0..10)
# base
trim = TrimSolid(Shape=extr, Cutters=cap_2)
Z_8 = UnitZ(Factor=Slider(10, range=0..10))
scale_4 = Scale(Geometry=scale_2.Geometry, Center=area_5.Centroid, Factor=Slider(0.95, range=0..1))  # -> Geometry, Transform
move_5 = Move(Geometry=scale_3.Geometry, Motion=Y)  # -> Geometry, Transform
extr_4 = Extrude(Base=scale_4.Geometry, Direction=Z_8)
move_6 = Move(Geometry=move_5.Geometry, Motion=X_2)  # -> Geometry, Transform
merge_2 = Merge(Data3=trim, Data4=cap_2)
Z_9 = UnitZ(Factor=Slider(2200.7, range=0..10000))
rotate = Rotate(Geometry=move_6.Geometry, Angle=degrees(Slider(109, range=0..180)), Plane=PlaneXY(0, 0, 0))  # -> Geometry, Transform
number_slider_2 = Slider(5, range=0..10)
number_slider_3 = Slider(5, range=0..10)
number_slider_4 = Slider(1, range=0..10)
number_slider_5 = Slider(1, range=0..10)
dispatch = Dispatch(List=rotate.Geometry, DispatchPattern=[True, False])  # -> ListA, ListB
move_7 = Move(Geometry=merge_2, Motion=Z_9)  # -> Geometry, Transform
Y_2 = UnitY(Factor=expr("-x", Slider(759, range=0..1000)))
X_3 = UnitX(Factor=expr("-x", Slider(699, range=0..1000)))
item = ListItem(List=dispatch.ListA, Index=0, Wrap=True)
item_2 = ListItem(List=dispatch.ListB, Index=0, Wrap=True)
divide = DivideDomain²(Domain=item_2, UCount=number_slider_3, VCount=number_slider_3)
divide_2 = DivideDomain²(Domain=item, UCount=number_slider_2, VCount=number_slider_2)
scale_5 = Scale(Geometry=move_7.Geometry, Center=end.End, Factor=Slider(30, range=0..100))  # -> Geometry, Transform
subsrf = Isotrim(Surface=item, Domain=divide_2)
subsrf_2 = Isotrim(Surface=item_2, Domain=divide)
move_8 = Move(Geometry=scale_5.Geometry, Motion=Y_2)  # -> Geometry, Transform
move_9 = Move(Geometry=move_8.Geometry, Motion=X_3)  # -> Geometry, Transform
X_4 = Slider(0, range=0..4)
Y_3 = Slider(0, range=0..4)
Z_10 = Slider(2000, range=0..2000)
X_5 = Slider(0, range=0..1)
Y_4 = Slider(0, range=0..1)
Z_11 = Slider(0, range=0..1)
rotate_2 = Rotate(Geometry=move_9.Geometry, Angle=degrees(Slider(109, range=0..180)), Plane=PlaneXY(0, 0, 0))  # -> Geometry, Transform
pt = ConstructPoint(XCoordinate=X_4, YCoordinate=Y_3, ZCoordinate=Z_10)
pt_2 = ConstructPoint(XCoordinate=X_5, YCoordinate=Y_4, ZCoordinate=Z_11)
number_slider_6 = Slider(650, range=0..1000)
panel = Panel("""0
2
3""")
merge_3 = Merge(Data1=end.End)
ln = Line(StartPoint=pt_2, EndPoint=pt)
division = Division(A=Slider(58, range=0..100), B=number_slider_6)
X_6 = UnitX(Factor=1)
crv_2 = Curve(reparameterize(ln))
samples = Slider(20, range=3..100)
radius = Slider(246.4241, range=0..300)
turns = Slider(20, range=0..100)
pos = BooleanToggle(True)
X_7 = UnitX(Factor=Slider(30, range=0..100))
line_2 = LineSDL(Start=merge_3, Direction=X_6, Length=Slider(30, range=0..100))
series_2 = Series(Start=0, Step=1, Count=expr("x+1", number_slider_6))
cyl = Cylinder(Base=merge_3, Radius=Slider(600, range=0..1000), Length=expr("-x", Slider(555, range=0..1000)))
series_3 = Series(Start=0, Step=division, Count=expr("x+1", number_slider_6))
move_10 = Move(Geometry=line_2, Motion=X_7)  # -> Geometry, Transform
cap_3 = CapHoles(Brep=cyl)
rotate_3 = Rotate(Geometry=move_10.Geometry, Angle=degrees(series_2), Plane=PlaneXY(0, 0, 0))  # -> Geometry, Transform
Z_12 = UnitZ(Factor=series_3)
expression = Expression(A=turns, B=samples, Expression="A/(B+1)")
debrep = DeconstructBrep(Brep=cap_3)  # -> Faces, Edges, Vertices
num = Number(-1)
frames = PerpFrames(Curve=crv_2, Count=samples, Align=True)  # -> Frames, Parameters
move_11 = Move(Geometry=rotate_3.Geometry, Motion=Z_12)  # -> Geometry, Transform
multiplication = Multiplication(A=expression, B=num)
loft = Loft(
    Curves=move_11.Geometry,
    Options={Adjust=False, Closed=False, LoftEnds=0, LoftSimp=0, LoftType=0, Rebuild=10, Refit=0.01})
filter = StreamFilter(Gate=pos, Stream0=multiplication, Stream1=expression)
cir = Circle(Plane=frames.Frames, Radius=radius)
scale_6 = Scale(Geometry=loft, Center=merge_3, Factor=Slider(10, range=0..100))  # -> Geometry, Transform
expression_2 = Expression(x=radius, Expression="2*x*pi")
series_4 = Series(Start=0, Step=filter, Count=expr("x+1", samples))
Z_13 = UnitZ(Factor=Slider(559, range=0..2000))
move_12 = Move(Geometry=scale_6.Geometry, Motion=expr("-x", Z_13))  # -> Geometry, Transform
divide_3 = DivideDomain²(Domain=move_12.Geometry, UCount=Slider(13, range=0..14), VCount=Slider(1, range=0..10))
Z_14 = UnitZ(Factor=Slider(25, range=0..100))
multiplication_2 = Multiplication(A=series_4, B=expression_2)
subsrf_3 = Isotrim(Surface=move_12.Geometry, Domain=divide_3)
extr_5 = Extrude(Base=move_12.Geometry, Direction=Z_14)
eval = EvaluateCurve(Curve=cir, Parameter=multiplication_2)  # -> Point, Tangent, Angle
item_3 = ListItem(List=subsrf_3, Index=Slider(12, range=0..100), Wrap=True)
Z_15 = UnitZ(Factor=Slider(85, range=0..1000))
debrep_2 = DeconstructBrep(Brep=extr_5)  # -> Faces, Edges, Vertices
panel_2 = Panel("""1
2""")
panel_3 = Panel("""0
3""")
extr_6 = Extrude(Base=item_3, Direction=Z_15)
intcrv = Interpolate(Vertices=eval.Point, Degree=3, Periodic=False, KnotStyle=1)  # -> Curve, Length, Domain
number_slider_7 = Slider(180, range=0..1000)
number_slider_8 = Slider(270, range=0..1000)
number_slider_9 = Slider(90, range=0..1000)
item_4 = ListItem(List=debrep_2.Vertices, Index=panel_2, Wrap=True)
item_5 = ListItem(List=debrep_2.Vertices, Index=panel_3, Wrap=True)
line_3 = LineSDL(Start=item_4, Direction=Vector(0, 0, 1), Length=expr("-x", Slider(298, range=0..1000)))
line_4 = LineSDL(Start=item_5, Direction=Vector(0, 0, 1), Length=Slider(600, range=0..1000))
pipe_2 = Pipe(Curve=intcrv.Curve, Radius=Slider(25, range=0..100), Caps=0)
rotate_4 = Rotate(Geometry=pipe_2, Angle=degrees(number_slider_7), Plane=PlaneXY(0, 0, 0))  # -> Geometry, Transform
rotate_5 = Rotate(Geometry=pipe_2, Angle=degrees(number_slider_8), Plane=PlaneXY(0, 0, 0))  # -> Geometry, Transform
rotate_6 = Rotate(Geometry=pipe_2, Angle=degrees(number_slider_9), Plane=PlaneXY(0, 0, 0))  # -> Geometry, Transform
rotate_7 = Rotate(Geometry=intcrv.Curve, Angle=degrees(number_slider_7), Plane=PlaneXY(0, 0, 0))  # -> Geometry, Transform
rotate_8 = Rotate(Geometry=intcrv.Curve, Angle=degrees(number_slider_8), Plane=PlaneXY(0, 0, 0))  # -> Geometry, Transform
rotate_9 = Rotate(Geometry=intcrv.Curve, Angle=degrees(number_slider_9), Plane=PlaneXY(0, 0, 0))  # -> Geometry, Transform
pipe_3 = Pipe(Curve=[line_4, line_3], Radius=Slider(10, range=0..100), Caps=0)
merge_4 = Merge(Data1=pipe_2, Data2=rotate_4.Geometry, Data3=rotate_5.Geometry, Data4=rotate_6.Geometry)
trim_2 = TrimSolid(Shape=merge_4, Cutters=cap_3)
diamond = DiamondPanels(Surface=subsrf_2, UDivisions=number_slider_4, VDivisions=number_slider_4)  # -> DiamondPanels, TriPanels
diamond_2 = DiamondPanels(Surface=subsrf, UDivisions=number_slider_5, VDivisions=number_slider_5)  # -> DiamondPanels, TriPanels
merge_5 = Merge(Data1=extr_5, Data2=pipe_3)
loft_2 = Loft(
    Curves=scale_4.Geometry,
    Options={Adjust=False, Closed=False, LoftEnds=0, LoftSimp=0, LoftType=0, Rebuild=10, Refit=0.01})
diamond_3 = DiamondPanels(Surface=loft_2, UDivisions=Slider(10, range=0..10), VDivisions=Slider(15, range=0..100))  # -> DiamondPanels, TriPanels
area_6 = Area(Geometry=diamond_3.DiamondPanels)  # -> Area, Centroid
scale_7 = Scale(Geometry=diamond_3.DiamondPanels, Center=area_6.Centroid, Factor=Slider(0.8, range=0..1))  # -> Geometry, Transform
merge_6 = Merge(Data1=move_4.Geometry, Data2=cap)
cap_4 = CapHoles(Brep=extr_4)
trim_3 = TrimSolid(Shape=trim_2, Cutters=merge_6)
trim_4 = TrimSolid(Shape=rotate_2.Geometry, Cutters=extr_6)
item_6 = ListItem(List=debrep.Faces, Index=panel, Wrap=True)
geo = Geometry(<brep referenced from the Rhino model>)
geo_2 = Geometry(<brep referenced from the Rhino model>)
geo_3 = Geometry(<brep referenced from the Rhino model>)
geo_4 = Geometry(<brep referenced from the Rhino model>)
geo_5 = Geometry(<brep referenced from the Rhino model>)
geo_6 = Geometry(<brep referenced from the Rhino model>)
geo_7 = Geometry(<brep referenced from the Rhino model>)
panel_4 = Panel("""{
  "type": "FeatureCollection",
  "features": [
    {
      "type": "Feature",
      "properties": {},
      "geometry": {
        "type": "Polygon",
        "coordinates": [
          [
            [
              150.9982395172119,
              -33.91572820435
            ],
            [
              150.99819660186768,
              -33.915799431702226
            ],
            [
              150.98721027374268,
              -33.91405434443387
            ],
            [
              150.98650217056274,
              -33.91425022335671
            ],
            [
              150.9829831123352,
              -33.91494469954614
            ],
            [
              150.98261833190918,
              -33.9165473153061
            ],
            [
              150.98036527633667,
              -33.92001954605315
            ],
            [
              150.98064422607422,
              -33.920535917000926
            ],
            [
              150.98169565200806,
              -33.92108789627745
            ],
            [
              150.98173856735227,
              -33.92545018732129
            ],
            [
              150.98023653030396,
              -33.92671431971315
            ],
            [
              150.9823179244995,
              -33.928797426527325
            ],
            [
              150.98733901977536,
              -33.92840573511806
            ],
            [
              150.9886908531189,
              -33.92940276425313
            ],
            [
              150.99332571029663,
              -33.93015052844514
            ],
            [
              150.9935188293457,
              -33.929598607890355
            ],
            [
              150.99319696426392,
              -33.92949178414406
            ],
            [
              150.99336862564087,
              -33.92881523063949
            ],
            [
              150.9957504272461,
              -33.9293315482734
            ],
            [
              150.99545001983643,
              -33.93061342679776
            ],
            [
              150.99838972091675,
              -33.93128996601822
            ],
            [
              150.99849700927732,
              -33.93018613610004
            ],
            [
              150.99903345108032,
              -33.930328566570815
            ],
            [
              150.99929094314575,
              -33.93048880056571
            ],
            [
              150.99997758865356,
              -33.93054221183035
            ],
            [
              151.00062131881714,
              -33.930862678714774
            ],
            [
              151.00525617599487,
              -33.93360440165605
            ],
            [
              151.00589990615845,
              -33.93419190223093
            ],
            [
              151.0068440437317,
              -33.93022174374006
            ],
            [
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""")
geo_8 = Geometry([<brep referenced from the Rhino model> x4])
panel_5 = Panel("""height
base_height
colour""")
brep = Brep([geo_6, geo, geo_3, geo_2, geo_4, geo_7, geo_5, geo_8])
contour = Contour(Shape=brep, Point=Point(0, 0, 0), Direction=Vector(0, 0, 1), Distance=Slider(2, range=0..10))
crv_3 = Curve(contour)
area_7 = Area(Geometry=contour)  # -> Area, Centroid
jsonpoly_1_1 = GeoJSONToPolyline11(J=panel_4)  # -> doc_2, P_2, K_3, V_3
pdecon = Deconstruct(Point=area_7.Centroid)  # -> XComponent, YComponent, ZComponent
entwine = Entwine(Branch00=pdecon.XComponent, Branch01=pdecon.YComponent, Branch02=pdecon.ZComponent, FlattenInputs=True)
crv_4 = Curve(jsonpoly_1_1.P_2)
polyjson_1_1 = PolygonToGeoJSON11(P=crv_3, K=panel_5, V=entwine)  # -> doc_2, J_2
panel_6 = Panel("C:\Users\bojce\Documents\Computational design\Semester 2, 2017\Urban Data (1230)\Assignment 3")
file_write = FileWrite(content=polyjson_1_1.J_2, file_path=panel_6, T="data.GeoJSON", activate=Toggle(True))

# ==== cluster PolygonToGeoJSON11: Writes a polygon to a GeoJSON file, where keys and values can be defined.
P = ClusterInput()
P_2 = Curve(P)
cp = ControlPoints(Curve=P_2)  # -> simplify(Points), Weights, Knots
V = ClusterInput()
K = ClusterInput()
V_2 = Data(simplify(V))
points_to_coordinates = PointsToCoordinates(P=cp.Points)
K_2 = Text(simplify(K))
clean = CleanTree(RemoveNulls=True, RemoveInvalid=True, RemoveEmpty=True, Tree=V_2)
viewer = ParamViewer(clean)
flip = FlipMatrix(Data=clean)
graft = GraftTree(Tree=K_2, IncludeEmptyLists=True, IncludeNullItems=True)  # -> simplify(Tree)
viewer_2 = ParamViewer(graft)
short = ShortestList(ListA=viewer_2, ListB=viewer, TrimMode=2)  # -> ListA, ListB
lng = ListLength(List=flatten(short.ListB))
series = Series(Start=0, Step=1, Count=lng)
item = ListItem(List=viewer_2, Index=series, Wrap=False)
flip_2 = FlipMatrix(Data=flip)
branch = TreeBranch(Tree=graft, Path=item, MaintainPaths=True)
clean_2 = CleanTree(RemoveNulls=True, RemoveInvalid=True, RemoveEmpty=True, Tree=branch)
flatten = FlattenTree(Tree=clean_2, Path="{0}")
rep = ReplaceText(Text="\"█\"", Find="█", Replace=flatten, RecursiveReplace=False)  # -> flatten(Result)
series_2 = Series(Start=0, Step=1, Count=lng)
mindex = MemberIndex(Set=rep, Member="\"height\"")  # -> Index, Count
rep_2 = ReplaceText(Text="{ \"type\": \"Polygon\",█}", Find="█", Replace=points_to_coordinates, RecursiveReplace=False)

# ---- group: Polygon
flatten_2 = FlattenTree(Tree=rep_2, Path="{0}")

# ----
mindex_2 = MemberIndex(Set=rep, Member="\"base_height\"")  # -> Index, Count
panel = Panel("Writes a polygon to a GeoJSON file, where keys and values can be defined. ")
panel_2 = Panel("""OUTPUTS:

GeoJSON (J) - Produces a GeoJSON Feature Collection.""")
panel_3 = Panel(""" 
INPUTS: 

Polyline Curve (P) - Polygon or list of polygons to convert to GeoJSON.

Key (K)- Properties used to describe geometry. To specify height, base height and colour, use the following keys: 

height
base_height
colour 

Value (V) - Values of properties. The list should be structured so that the first branch of data is associated with the first key. This allows unique values to be associated with multiple polygons. """)
panel_4 = Panel("For more documentation visit: github.com/madeleinejohanson/Humpback")
rep_3 = ReplaceText(Text="{\"type\":\"Feature\",\"geometry\":█", Find="█", Replace=flatten_2, RecursiveReplace=False)
merge = Merge(Data1="POLYGON TO GEOJSON", Data2=panel, Data3=panel_3, Data6=panel_2, Data7=panel_4)
doc = Text(merge)
doc_2 = ClusterOutput(doc)
panel_5 = Panel(doc)

# ---- group: Keeps lists consistent lengths, repeating the last value for the total amount of keys
null = NullItem(Item=flip)  # -> NullFlags, InvalidFlags, Description
dispatch = Dispatch(List=flip, DispatchPattern=null.NullFlags)  # -> ListA, ListB
nullrep = ReplaceNulls(Items=flip, Replacements="█")  # -> Items, Count
index = ItemIndex(List=dispatch.ListB, Item=dispatch.ListB)
item_2 = ListItem(List=flip, Index=index, Wrap=True)
mindex_3 = MemberIndex(Set=nullrep.Items, Member="█")  # -> Index, Count
flip_3 = FlipMatrix(Data=item_2)
clean_3 = CleanTree(RemoveNulls=True, RemoveInvalid=True, RemoveEmpty=False, Tree=flip_3)
item_3 = ListItem(List=clean_3, Index=0, Wrap=True)  # -> flatten(Item1), Item

# ----
merge_2 = Merge(Data1=flip_3, Data2=flip_2)
clean_4 = CleanTree(RemoveNulls=True, RemoveInvalid=True, RemoveEmpty=False, Tree=merge_2)
item_4 = ListItem(List=clean_4, Index=0, Wrap=True)  # -> flatten(Item1), Item

# ---- group: Keeps lists consistent lengths, repeating the last value for the total amount of keys (continued)
item_5 = ListItem(List=item_4.Item1, Index=mindex_3.Index, Wrap=True)
replace = ReplaceItems(List=nullrep.Items, Item=item_5, Indices=mindex_3.Index, Wrap=False)

# ----
flip_4 = FlipMatrix(Data=replace)
viewer_3 = ParamViewer(flip_4)
item_6 = ListItem(List=viewer_3, Index=series_2, Wrap=True)

# ---- group: Keeps lists consistent lengths, repeating the last value for the total amount of keys (continued)
branch_2 = TreeBranch(Tree=flip_4, Path=item_6, MaintainPaths=True)  # -> simplify(Branch)

# ----
flip_5 = FlipMatrix(Data=branch_2)

# ---- group: height
item_7 = ListItem(List=flip_5, Index=mindex.Index, Wrap=True)

# ---- group: base_height
item_8 = ListItem(List=flip_5, Index=mindex_2.Index, Wrap=True)

# ----
addition = Addition(A=item_7, B=item_8)
replace_2 = ReplaceItems(List=simplify(flip_5), Item=addition, Indices=mindex.Index, Wrap=False)  # -> simplify(List)
clean_5 = CleanTree(RemoveNulls=True, RemoveInvalid=True, RemoveEmpty=True, Tree=replace_2)
key_value = KeyValue(K=clean_2, V=clean_5)
rep_4 = ReplaceText(Text=",\"properties\":█}", Find="█", Replace=key_value, RecursiveReplace=False)

# ---- group: Feature
concat = Concatenate(FragmentA=rep_3, FragmentB=rep_4)  # -> flatten(Result)

# ----
join = TextJoin(Text=concat, Join=",")
panel_6 = Panel(key_value)
rep_5 = ReplaceText(Text="{\"type\":\"FeatureCollection\",\"features\":[█]}", Find="█", Replace=join, RecursiveReplace=False)
J = Text(rep_5)
J_2 = ClusterOutput(J)

# ==== cluster FileWrite: Exports text to file
content = ClusterInput()
file_path = ClusterInput()
activate = ClusterInput()
T = ClusterInput()
content_2 = Data(content)
file_path_2 = Text(file_path)
join = TextJoin(Text=[file_path_2, T], Join="\")
vb = VBScript(path=simplify(join), lines=simplify(content_2), activate=activate)  # -> out, A
# ---------- vb: VB ----------
    If (activate = True)
      
      system.IO.File.WriteAllText(path, lines)
      A = "File written"
    Else
      A = "Not activated"
    End If
# ---------- end vb ----------

# ==== cluster GeoJSONToPolyline11: Converts GeoJSON into Grasshopper geometry.
J = ClusterInput()
J_2 = Text(J)
rep = ReplaceText(Text=J_2, Find=" ", RecursiveReplace=False)
python = PythonScript(json_string=rep)  # -> doc, polylines, key, value, xyzList, coordList
# ---------- python: Python ----------
doc = """Split featureJSON into features
more exlantion here
HELLO!!!
"""
import json
import rhinoscriptsyntax as rs
import Rhino.Geometry as rg
appendPolyline = []

def main():
    raw_json = json.loads(json_string)
    features_list = raw_json["features"]
    propertieslist = [] 
    valuelist = []
    coordList =[]
    
    for item in features_list:
        coordinates = item['geometry']['coordinates']
        coordList.append(str(coordinates))
        try:#properties
            item['properties']
            properties=item['properties']
            propertieslist.append(properties)
            value = []
            for prop in properties:
                item_value = item['properties'][prop]
                value.append(item_value)
            valuelist.append(value)
        except KeyError: 
            properties = "<null>"
            propertieslist.append(properties)
    return {
            "coordList":coordList,
            "key":propertieslist,
            "value":valuelist,
            }
results = main()
coordList = results["coordList"]
key = results["key"]
value = results["value"]
#colour= results["colour"]
#polylines = results["polylines"]
#brep = results["brep"]
# ---------- end python ----------
python_2 = PythonScript(x=python.key)  # -> simplify(a)
# ---------- python_2: Python ----------
a=x
# ---------- end python_2 ----------
python_3 = PythonScript(x=python.value)  # -> simplify(a); same code as python_2
panel = Panel("""OUTPUTS:

Polyline Curve (P)- Closed Polyline.

Keys (K) - Outputs keys found in properties

Values (V) - Outputs values found in properties""")
panel_2 = Panel(""" 
INPUTS: 

GeoJSON (J) - FeatureCollection containing geoemtry type objects.
*Only accepts easting, northing (N,E) coordinates.
 """)
panel_3 = Panel("For more documentation visit: github.com/madeleinejohanson/Humpback")
lng = ListLength(List=python.coordList)

# ---- group: List of coordinates
data = Data(python.coordList)

# ----
equals = Equality(FirstNumber=lng, SecondNumber=1)  # -> Equality, Inequality
rep_2 = ReplaceText(Text=data, Find=" ", RecursiveReplace=False)
gate = StreamGate(Gate=0)  # -> Target0, Target1
split = TextSplit(Text=rep_2, Separators=",")  # -> simplify(Result)
merge = Merge(
    Data1="GEOJSON TO POLYGON",
    Data2="Converts GeoJSON into Grasshopper geometry.",
    Data3=panel_2,
    Data4=panel,
    Data5=panel_3)
doc = Text(merge)

cull_i = CullIndex(List=split, Indices=0, Wrap=True)
cull_i_2 = CullIndex(List=cull_i, Indices=-1, Wrap=True)

doc_2 = ClusterOutput(doc)
dispatch = Dispatch(List=cull_i_2, DispatchPattern=[False, True])  # -> simplify(ListA), ListB
chars = Characters(Text=dispatch.ListA)  # -> Result, Unicode
mindex = MemberIndex(Set=chars.Result, Member="[")  # -> Index, Count
equals_2 = Equality(FirstNumber=mindex.Count, SecondNumber=2)  # -> simplify(Equality), Inequality
trim = TrimTree(Tree=equals_2.Equality, Depth=1)
ma = MassAddition(Input=trim)  # -> Result, PartialResults
dispatch_2 = Dispatch(List=dispatch.ListA, DispatchPattern=trim)  # -> ListA, ListB
larger = LargerThan(FirstNumber=flatten(ma.Result), SecondNumber=0)  # -> LargerThan, OrEqualTo
viewer = ParamViewer(ma.Result)
index = ItemIndex(List=split, Item=dispatch_2.ListA)  # -> simplify(Index)
clean = CleanTree(RemoveNulls=True, RemoveInvalid=True, RemoveEmpty=True, Tree=index)
short = ShortestList(ListA=Slider(0, range=0..100), ListB=clean, TrimMode=2)  # -> ListA, ListB
dispatch_3 = Dispatch(List=viewer, DispatchPattern=larger.LargerThan)  # -> ListA, ListB
branch = TreeBranch(Tree=split, Path=dispatch_3.ListA, MaintainPaths=True)
branch_2 = TreeBranch(Tree=split, Path=dispatch_3.ListB, MaintainPaths=True)  # -> simplify(Branch)
lng_2 = ListLength(List=branch)
merge_2 = Merge(Data1=short.ListA, Data2=index, Data3=lng_2)
cull_i_3 = CullIndex(List=merge_2, Indices=-1, Wrap=True)
shift = ShiftList(List=merge_2, Shift=1, Wrap=False)
path_mapper = PathMapper(branch_2, source="{A}", target="{A;0}")
subtraction = Subtraction(A=shift, B=cull_i_3)
partition = PartitionList(List=split, Size=subtraction)  # -> simplify(Chunks)
merge_3 = Merge(Data1=path_mapper, Data2=partition)
filter = StreamFilter(Gate=equals.Equality, Stream0=merge_3, Stream1=split)
rep_3 = ReplaceText(Text=filter, Find="[", RecursiveReplace=False)
rep_4 = ReplaceText(Text=rep_3, Find="]", RecursiveReplace=False)
dispatch_4 = Dispatch(List=rep_4, DispatchPattern=[True, False])  # -> ListA, ListB
number_slider = Slider(100000, range=0..100000)
K = Text(simplify(python_2))
V = Data(simplify(python_3))
multiplication = Multiplication(A=dispatch_4.ListB, B=number_slider)
multiplication_2 = Multiplication(A=dispatch_4.ListA, B=number_slider)
pt = ConstructPoint(XCoordinate=multiplication_2, YCoordinate=multiplication, ZCoordinate=0)
lng_3 = ListLength(List=pt)
join = TextJoin(Text=K, Join="█")
join_2 = TextJoin(Text=V, Join="█")
larger_2 = LargerThan(FirstNumber=lng_3, SecondNumber=2)  # -> LargerThan, OrEqualTo
pline = PolyLine(Vertices=pt, Closed=larger_2.LargerThan)
crv = Curve(pline)
P = Curve(simplify(crv))
utrim = UberTrim(data=P, bool=False)
lng_4 = ListLength(List=utrim)
repeat = RepeatData(Data=join, Length=lng_4)
repeat_2 = RepeatData(Data=join_2, Length=lng_4)
split_2 = TextSplit(Text=repeat, Separators="█")  # -> simplify(Result)
split_3 = TextSplit(Text=repeat_2, Separators="█")  # -> simplify(Result)
P_2 = ClusterOutput(P)
K_2 = Text(simplify(split_2))
V_2 = Data(simplify(split_3))
K_3 = ClusterOutput(K_2)
V_3 = ClusterOutput(V_2)

# ==== cluster PointsToCoordinates
P = ClusterInput()
number_slider = Slider(100042, range=0..1000000)
pt2num = PointsToNumbers(Points=graft(P), Mask=4)
number_slider_2 = Slider(1000404, range=0..10000000)
division = Division(A=pt2num, B=Slider(100000, range=0..100000))
expression = Expression(x=division, Expression="format(\"{0}\",x)")
int = Integer(99960)
item = ListItem(List=expression, Index=0, Wrap=True)  # -> Item, Item1, Item2
panel = Panel(pt2num)
num = Number(item.Item2)  # disabled
merge = Merge(Data1=item.Item, Data2=item.Item1, Data3=num)
panel_2 = Panel(division)
wrapper = Wrapper(wrap="[", content=merge, join=",")  # -> simplify(wrapped)
utrim = UberTrim(data=wrapper, bool=Toggle(True))
wrapper_2 = Wrapper(wrap="[", content=utrim, join=",")
rep = ReplaceText(Text="\"coordinates\": [█]", Find="█", Replace=wrapper_2, RecursiveReplace=False)  # -> simplify(Result)
R = ClusterOutput(rep)

# ==== cluster KeyValue
K = ClusterInput()
V = ClusterInput()
K_2 = Text(simplify(K))
V_2 = Data(simplify(V))

# ---- group: HUMPBACK 1.1 Treats numbers as numbers instead of strings
int = Integer(V_2)
null = NullItem(Item=int)  # -> NullFlags, InvalidFlags, Description
panel = Panel("""█
"█"
""")
item = ListItem(List=panel, Index=null.NullFlags, Wrap=True)
rep = ReplaceText(Text=item, Find="█", Replace=V_2, RecursiveReplace=False)

# ----
panel_2 = Panel(K_2)
rep_2 = ReplaceText(Text="\"█\"", Find="█", Replace=K_2, RecursiveReplace=False)  # -> simplify(Result)
panel_3 = Panel("\"█\"")  # disabled
panel_4 = Panel("█")  # disabled
rep_3 = ReplaceText(Text=panel_3, Find=panel_4, Replace=V_2, RecursiveReplace=False)  # disabled
flip = FlipMatrix(Data=rep)  # -> simplify(Data)
lng = ListLength(List=flatten(rep_2))
viewer = ParamViewer(flip)
series = Series(Start=0, Step=1, Count=lng)
item_2 = ListItem(List=viewer, Index=series, Wrap=True)
branch = TreeBranch(Tree=simplify(flip), Path=simplify(item_2), MaintainPaths=True)
long = LongestList(ListA=rep_2, ListB=branch, PaddingMode=2)  # -> ListA, ListB
merge = Merge(Data1=graft(long.ListA), Data2=graft(long.ListB))
join = TextJoin(Text=merge, Join=":")
trim = TrimTree(Tree=join, Depth=1)
flip_2 = FlipMatrix(Data=trim)
join_2 = TextJoin(Text=flip_2, Join=",")
rep_4 = ReplaceText(Text="{█}", Find="█", Replace=join_2, RecursiveReplace=False)  # -> flatten(Result)
J = Text(rep_4)
J_2 = ClusterOutput(J)

# ==== cluster UberTrim: Better version of Trim
data = ClusterInput()
bool = ClusterInput()
data_2 = Data(data)
trim = TrimTree(Tree=data_2, Depth=1)
null = NullItem(Item=trim)  # -> NullFlags, InvalidFlags, Description
dispatch = Dispatch(List=data_2, DispatchPattern=null.NullFlags)  # -> ListA, ListB
bool_2 = Boolean(bool)
trim_2 = TrimTree(Tree=dispatch.ListB, Depth=1)
bool_3 = Boolean(invert(null.NullFlags))
flatten = FlattenTree(Tree=dispatch.ListA, Path="{0}")
merge = Merge(Data1=flatten, Data2=trim_2)
panel = Panel(null.NullFlags)
trim_3 = TrimTree(Tree=data_2, Depth=bool_3)
bool_4 = Boolean(invert(bool_2))
data_3 = Data(trim_3)
dispatch_2 = Dispatch(List=merge, DispatchPattern=bool_4)  # -> ListA, ListB
dispatch_3 = Dispatch(List=data_3, DispatchPattern=bool_2)  # -> ListA, ListB
clean = CleanTree(RemoveNulls=True, RemoveInvalid=True, RemoveEmpty=True, Tree=dispatch_3.ListB)
clean_2 = CleanTree(RemoveNulls=True, RemoveInvalid=True, RemoveEmpty=True, Tree=dispatch_2.ListB)
merge_2 = Merge(Data1=clean, Data2=clean_2)
R = ClusterOutput(merge_2)
panel_2 = Panel(merge_2)

# ==== cluster Wrapper: Wraps data with a wrapping character
join = ClusterInput()  # Join character
content = ClusterInput()  # Content to be wrapped
wrap = ClusterInput()  # Wrap character or XML tag
txt = Text(join)
null = NullItem(Item=txt)  # -> NullFlags, InvalidFlags, Description
data = Data(content)
tmatch = MatchText(Text=wrap, RegEx="<*.>", Case=True)
bool = Boolean(null.NullFlags)
dispatch = Dispatch(List=data, DispatchPattern=bool)  # -> ListA, ListB
item = ListItem(List=wrap, Index=0, Wrap=True)
split = TextSplit(Text=item, Separators=" ")
join_2 = TextJoin(Text=dispatch.ListB, Join=txt)
panel = Panel("""{
[
(
"
'""")
panel_2 = Panel("""{█}
[█]
(█)
"█"
'█'""")
item_2 = ListItem(List=split, Index=0, Wrap=True)
weave = Weave(Pattern=bool, Stream0=join_2, Stream1=dispatch.ListA, NullGaps=False)
data_2 = Data(wrap)
replace = ReplaceMembers(Set=data_2, Find=panel, Replace=panel_2)
rep = ReplaceText(Text=item_2, Find="<", Replace="</", RecursiveReplace=False)
expression = Expression(x=item, y=rep, Expression="Format(\"{0}█{1}>\", x, y)")
rep_2 = ReplaceText(Text=expression, Find=">>", Replace=">", RecursiveReplace=False)
weave_2 = Weave(Pattern=tmatch, Stream0=replace, Stream1=rep_2, NullGaps=False)
rep_3 = ReplaceText(Text=weave_2, Find="█", Replace=weave, RecursiveReplace=False)
data_3 = Data(rep_3)
wrapped = ClusterOutput(data_3)  # Wrapped Output
